# Grasshopper definition 05_DaylightGlareProbability_DGNB_XX.gh (Grasshopper 1.0.7)
# plug-ins: Human, EleFront, LadybugGrasshopper, MetaHopper

# ----
# Define boundary conditions
# Visualize north arrow
weather_file = Panel("DK_DRY_2001-2010.epw")
# 5)
# Choose a weather file
file_path = Panel("C:\Radiance\WeatherFiles")
# Set model rotation
north_rotation_counter_clockwise = Slider(0, range=0..360)
# 6)
boolean_toggle = BooleanToggle(False)
hide_show_object_preview = HideShowObjectPreview(Visible=boolean_toggle)

# ----
# Define project name
# 1)
# File path: <Insert path for the folder, where the Rhino model is stored>
project_name = Panel("<Project_Name>")
concatenate = Concatenate(FragmentA=project_name, FragmentA_2="_")

# ----
# Import geometry from Rhino to Grasshopper
# 3)
# 4)
lb_falsestarttoggle = LBFalseStartToggle(True)
enable_disable_object = EnableDisableObject(
    Enabled=lb_falsestarttoggle,
    AllObjects_Object=[import_apertures_2, import_apertures_6, import_apertures, import_apertures_5, import_apertures_4, import_apertures_3, cluster_20, cluster_19, cluster_17, cluster_18, cluster_16, cluster_15, cluster_14, cluster_13, cluster_11, cluster_12, cluster_33, cluster_32, cluster_31, cluster_34])

# ----
# Visualize geometry
# Visualize wireframe
# Visualize opaque materials
# Visualize windows
# Visualize shading
# Visualize grid points
lb_falsestarttoggle_2 = LBFalseStartToggle(False)
hide_show_object_preview_2 = HideShowObjectPreview(Visible=lb_falsestarttoggle_2, AllObjects_Object=vizwiref)
lb_falsestarttoggle_3 = LBFalseStartToggle(True)
hide_show_object_preview_3 = HideShowObjectPreview(
    Visible=lb_falsestarttoggle_3,
    AllObjects_Object=[custom_preview_10, custom_preview_7, custom_preview, custom_preview_8, custom_preview_5, custom_preview_6, custom_preview_2, custom_preview_3, custom_preview_4, custom_preview_9])
lb_falsestarttoggle_4 = LBFalseStartToggle(True)
hide_show_object_preview_4 = HideShowObjectPreview(
    Visible=lb_falsestarttoggle_4,
    AllObjects_Object=[custom_preview_12, custom_preview_11, custom_preview_13, custom_preview_15, custom_preview_16, custom_preview_14])
lb_falsestarttoggle_5 = LBFalseStartToggle(True)
hide_show_object_preview_5 = HideShowObjectPreview(
    Visible=lb_falsestarttoggle_5,
    AllObjects_Object=[hide_show_object_preview_5, custom_preview_17, custom_preview_18, custom_preview_19, custom_preview_20])
lb_falsestarttoggle_6 = LBFalseStartToggle(True)
hide_show_object_preview_6 = HideShowObjectPreview(Visible=lb_falsestarttoggle_6)

reflectance = ValueList({"0.01", "0.02", "0.03", "0.04", "0.05", "0.06", "0.07", "0.08", "0.09", "0.10"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}, selected="0.50")

reflectance_2 = ValueList({"0.01", "0.02", "0.03", "0.04", "0.05", "0.06", "0.07", "0.08", "0.09", "0.10"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}, selected="0.70")

reflectance_3 = ValueList({"0.01", "0.02", "0.03", "0.04", "0.05", "0.06", "0.07", "0.08", "0.09", "0.10"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}, selected="0.70")
colour_swatch = ColourSwatch(SwatchColor=RGB(120, 99, 99))

reflectance_4 = ValueList({"0.01", "0.02", "0.03", "0.04", "0.05", "0.06", "0.07", "0.08", "0.09", "0.10"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}, selected="0.20")

reflectance_5 = ValueList({"0.01", "0.02", "0.03", "0.04", "0.05", "0.06", "0.07", "0.08", "0.09", "0.10"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}, selected="0.70")
colour_swatch_2 = ColourSwatch(SwatchColor=RGB(120, 80, 80))

reflectance_6 = ValueList({"0.01", "0.02", "0.03", "0.04", "0.05", "0.06", "0.07", "0.08", "0.09", "0.10"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}, selected="0.20")

reflectance_7 = ValueList({"0.01", "0.02", "0.03", "0.04", "0.05", "0.06", "0.07", "0.08", "0.09", "0.10"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}, selected="0.20")

reflectance_8 = ValueList({"0.01", "0.02", "0.03", "0.04", "0.05", "0.06", "0.07", "0.08", "0.09", "0.10"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}, selected="0.20")

reflectance_9 = ValueList({"0.01", "0.02", "0.03", "0.04", "0.05", "0.06", "0.07", "0.08", "0.09", "0.10"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}, selected="0.50")

reflectance_10 = ValueList({"0.01", "0.02", "0.03", "0.04", "0.05", "0.06", "0.07", "0.08", "0.09", "0.10"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}, selected="0.20")

# ----
# 2b)
# Modify RAD materials
# Solids
panel = Panel("0_Solids::")
cluster = Cluster_2(A=panel, layer="Column_Int", reflectance=reflectance)  # -> rad_name_2, rhino_layer_name_2
cluster_2 = Cluster_2(A=panel, layer="Ceiling", reflectance=reflectance_2)  # -> rad_name_2, rhino_layer_name_2
cluster_3 = Cluster_2(A=panel, layer="Door", reflectance=reflectance_3)  # -> rad_name_2, rhino_layer_name_2
cluster_4 = Cluster_2(A=panel, layer="Floor", reflectance=reflectance_4)  # -> rad_name_2, rhino_layer_name_2
cluster_5 = Cluster_2(A=panel, layer="Frames", reflectance=reflectance_5)  # -> rad_name_2, rhino_layer_name_2
cluster_6 = Cluster_2(A=panel, layer="Roof", reflectance=reflectance_6)  # -> rad_name_2, rhino_layer_name_2
cluster_7 = Cluster_2(A=panel, layer="Column_Ext", reflectance=reflectance_7)  # -> rad_name_2, rhino_layer_name_2
cluster_8 = Cluster_2(A=panel, layer="Stairs_Int", reflectance=reflectance_8)  # -> rad_name_2, rhino_layer_name_2
cluster_9 = Cluster_2(A=panel, layer="Wall_Int", reflectance=reflectance_9)  # -> rad_name_2, rhino_layer_name_2
cluster_10 = Cluster_2(A=panel, layer="Wall_Ext", reflectance=reflectance_10)  # -> rad_name_2, rhino_layer_name_2
cluster_11 = Cluster_3(lay=cluster.rhino_layer_name_2)
cluster_12 = Cluster_3(lay=cluster_2.rhino_layer_name_2)
cluster_13 = Cluster_3(lay=cluster_3.rhino_layer_name_2)
cluster_14 = Cluster_3(lay=cluster_4.rhino_layer_name_2)
cluster_15 = Cluster_3(lay=cluster_5.rhino_layer_name_2)
cluster_16 = Cluster_3(lay=cluster_6.rhino_layer_name_2)
cluster_17 = Cluster_3(lay=cluster_7.rhino_layer_name_2)
cluster_18 = Cluster_3(lay=cluster_8.rhino_layer_name_2)
cluster_19 = Cluster_3(lay=cluster_9.rhino_layer_name_2)
cluster_20 = Cluster_3(lay=cluster_10.rhino_layer_name_2)
opaquemod = HBOpaqueModifier(name=cluster.rad_name_2, reflect=reflectance)  # -> modifier; plug-in component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
opaquemod_2 = HBOpaqueModifier(name=cluster_2.rad_name_2, reflect=reflectance_2)  # -> modifier; plug-in component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
opaquemod_3 = HBOpaqueModifier(name=cluster_3.rad_name_2, reflect=reflectance_3)  # -> modifier; plug-in component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
opaquemod_4 = HBOpaqueModifier(name=cluster_4.rad_name_2, reflect=reflectance_4)  # -> modifier; plug-in component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
opaquemod_5 = HBOpaqueModifier(name=cluster_5.rad_name_2, reflect=reflectance_5)  # -> modifier; plug-in component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
opaquemod_6 = HBOpaqueModifier(name=cluster_6.rad_name_2, reflect=reflectance_6)  # -> modifier; plug-in component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
opaquemod_7 = HBOpaqueModifier(name=cluster_7.rad_name_2, reflect=reflectance_7)  # -> modifier; plug-in component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
opaquemod_8 = HBOpaqueModifier(name=cluster_8.rad_name_2, reflect=reflectance_8)  # -> modifier; plug-in component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
opaquemod_9 = HBOpaqueModifier(name=cluster_9.rad_name_2, reflect=reflectance_9)  # -> modifier; plug-in component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
opaquemod_10 = HBOpaqueModifier(name=cluster_10.rad_name_2, reflect=reflectance_10)  # -> modifier; plug-in component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
face = HBFace(geo=cluster_11, name=cluster.rad_name_2, rad_mod=opaquemod)  # -> out, faces; plug-in component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
face_2 = HBFace(geo=cluster_12, name=cluster_2.rad_name_2, rad_mod=opaquemod_2)  # -> out, faces; plug-in component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
face_3 = HBFace(geo=cluster_17, name=cluster_7.rad_name_2, rad_mod=opaquemod_7)  # -> out, faces; plug-in component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
face_4 = HBFace(geo=cluster_13, name=cluster_3.rad_name_2, rad_mod=opaquemod_3)  # -> out, faces; plug-in component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
face_5 = HBFace(geo=cluster_14, name=cluster_4.rad_name_2, rad_mod=opaquemod_4)  # -> out, faces; plug-in component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
face_6 = HBFace(geo=cluster_15, name=cluster_5.rad_name_2, rad_mod=opaquemod_5)  # -> out, faces; plug-in component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
face_7 = HBFace(geo=cluster_16, name=cluster_6.rad_name_2, rad_mod=opaquemod_6)  # -> out, faces; plug-in component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
face_8 = HBFace(geo=cluster_18, name=cluster_8.rad_name_2, rad_mod=opaquemod_8)  # -> out, faces; plug-in component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
face_9 = HBFace(geo=cluster_19, name=cluster_9.rad_name_2, rad_mod=opaquemod_9)  # -> out, faces; plug-in component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
face_10 = HBFace(geo=cluster_20, name=cluster_10.rad_name_2, rad_mod=opaquemod_10)  # -> out, faces; plug-in component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
vizall = HBVisualizeAll(hb_objs=flatten(face_5.faces))  # -> geo; plug-in component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
vizall_2 = HBVisualizeAll(hb_objs=flatten(face_9.faces))  # -> geo; plug-in component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
vizall_3 = HBVisualizeAll(hb_objs=flatten(face_10.faces))  # -> geo; plug-in component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
vizall_4 = HBVisualizeAll(hb_objs=flatten(face_3.faces))  # -> geo; plug-in component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
vizall_5 = HBVisualizeAll(hb_objs=flatten(face_7.faces))  # -> geo; plug-in component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
vizall_6 = HBVisualizeAll(hb_objs=flatten(face_8.faces))  # -> geo; plug-in component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
vizall_7 = HBVisualizeAll(hb_objs=flatten(face_4.faces))  # -> geo; plug-in component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
vizall_8 = HBVisualizeAll(hb_objs=flatten(face_6.faces))  # -> geo; plug-in component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
vizall_9 = HBVisualizeAll(hb_objs=flatten(face.faces))  # -> geo; plug-in component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
vizall_10 = HBVisualizeAll(hb_objs=flatten(face_2.faces))  # -> geo; plug-in component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
custom_preview = CustomPreview(Geometry=vizall, Material=ColourSwatch(SwatchColor=RGB(88, 89, 89)))
custom_preview_2 = CustomPreview(Geometry=vizall_2, Material=ColourSwatch(SwatchColor=RGB(148, 148, 148)))
custom_preview_3 = CustomPreview(Geometry=vizall_3, Material=ColourSwatch(SwatchColor=RGB(255, 255, 255)))
custom_preview_4 = CustomPreview(Geometry=vizall_4, Material=ColourSwatch(SwatchColor=RGB(168, 168, 168)))
custom_preview_5 = CustomPreview(Geometry=vizall_5, Material=ColourSwatch(SwatchColor=RGB(12, 12, 13)))
custom_preview_6 = CustomPreview(Geometry=vizall_6, Material=ColourSwatch(SwatchColor=RGB(168, 168, 168)))
custom_preview_7 = CustomPreview(Geometry=vizall_7, Material=colour_swatch)
custom_preview_8 = CustomPreview(Geometry=vizall_8, Material=colour_swatch_2)
custom_preview_9 = CustomPreview(Geometry=vizall_9, Material=ColourSwatch(SwatchColor=RGB(109, 110, 110)))
custom_preview_10 = CustomPreview(Geometry=vizall_10, Material=ColourSwatch(SwatchColor=RGB(109, 110, 110)))
faces = Merge(
    Data1=face_2.faces,
    Data2=face.faces,
    Data3=face_3.faces,
    Data4=face_4.faces,
    Data5=face_5.faces,
    Data6=face_6.faces,
    Data7=face_7.faces,
    Data8=face_8.faces,
    Data9=face_9.faces,
    Data10=face_10.faces)
layer_names = Merge(
    Data1=cluster_2.rhino_layer_name_2,
    Data2=cluster.rhino_layer_name_2,
    Data3=cluster_7.rhino_layer_name_2,
    Data4=cluster_3.rhino_layer_name_2,
    Data5=cluster_4.rhino_layer_name_2,
    Data6=cluster_5.rhino_layer_name_2,
    Data7=cluster_6.rhino_layer_name_2,
    Data8=cluster_8.rhino_layer_name_2,
    Data9=cluster_9.rhino_layer_name_2,
    Data10=cluster_10.rhino_layer_name_2)
layer_colours = Merge(
    Data1=ColourSwatch(SwatchColor=RGB(240, 230, 228)),
    Data2=ColourSwatch(SwatchColor=RGB(255, 173, 245)),
    Data3=ColourSwatch(SwatchColor=RGB(235, 45, 252)),
    Data4=colour_swatch,
    Data5=ColourSwatch(SwatchColor=RGB(255, 255, 255)),
    Data6=colour_swatch_2,
    Data7=ColourSwatch(SwatchColor=RGB(153, 83, 245)),
    Data8=ColourSwatch(SwatchColor=RGB(252, 45, 45)),
    Data9=ColourSwatch(SwatchColor=RGB(156, 156, 156)),
    Data10=ColourSwatch(SwatchColor=RGB(250, 141, 7)))
data = Data(faces)
clean = CleanTree(RemoveNulls=True, RemoveInvalid=True, RemoveEmpty=True, Tree=data)
# INPUT PARAMETRE
vizwiref = HBVisualizeWireframe(hb_objs=flatten(clean))  # -> geo; plug-in component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

transmittance = ValueList({"1", "2", "3", "4", "5", "6", "7", "8", "9", "10"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}, selected="64")
colour_swatch_3 = ColourSwatch(SwatchColor=RGBA(0, 238, 255, 100))

transmittance_2 = ValueList({"1", "2", "3", "4", "5", "6", "7", "8", "9", "10"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}, selected="74")
colour_swatch_4 = ColourSwatch(SwatchColor=RGBA(0, 128, 0, 100))

transmittance_3 = ValueList({"1", "2", "3", "4", "5", "6", "7", "8", "9", "10"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}, selected="71")

transmittance_4 = ValueList({"1", "2", "3", "4", "5", "6", "7", "8", "9", "10"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}, selected="77")
colour_swatch_5 = ColourSwatch(SwatchColor=RGBA(60, 255, 0, 100))

transmittance_5 = ValueList({"1", "2", "3", "4", "5", "6", "7", "8", "9", "10"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}, selected="41")

transmittance_6 = ValueList({"1", "2", "3", "4", "5", "6", "7", "8", "9", "10"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}, selected="82")
colour_swatch_6 = ColourSwatch(SwatchColor=RGBA(179, 0, 255, 100))

# ----
# Apertures/Glazing
panel_2 = Panel("1_Glazings::")
cluster_21 = Cluster(A=panel_2, layer="Glass_Int", transmittance=transmittance_6, colour_of_layer_in_rhino=colour_swatch_6)  # -> rad_name_2, result, layer_name_2, colour_of_layer_in_rhino_3
cluster_22 = Cluster(
    A=panel_2,
    layer="OvenlysKuppel",
    transmittance=transmittance_5,
    colour_of_layer_in_rhino=ColourSwatch(SwatchColor=RGBA(0, 115, 255, 100)))  # -> rad_name_2, result, layer_name_2, colour_of_layer_in_rhino_3
cluster_23 = Cluster(A=panel_2, layer="Glass", transmittance=transmittance, colour_of_layer_in_rhino=colour_swatch_3)  # -> rad_name_2, result, layer_name_2, colour_of_layer_in_rhino_3
cluster_24 = Cluster(A=panel_2, layer="Glass", transmittance=transmittance_2, colour_of_layer_in_rhino=colour_swatch_4)  # -> rad_name_2, result, layer_name_2, colour_of_layer_in_rhino_3
cluster_25 = Cluster(A=panel_2, layer="Glass", transmittance=transmittance_4, colour_of_layer_in_rhino=colour_swatch_5)  # -> rad_name_2, result, layer_name_2, colour_of_layer_in_rhino_3
cluster_26 = Cluster(
    A=panel_2,
    layer="OvenlysFlad",
    transmittance=transmittance_3,
    colour_of_layer_in_rhino=ColourSwatch(SwatchColor=RGBA(0, 115, 255, 100)))  # -> rad_name_2, result, layer_name_2, colour_of_layer_in_rhino_3
import_apertures = ImportApertures(lay=cluster_21.layer_name_2)
import_apertures_2 = ImportApertures(lay=cluster_22.layer_name_2)
import_apertures_3 = ImportApertures(lay=cluster_23.layer_name_2)
import_apertures_4 = ImportApertures(lay=cluster_24.layer_name_2)
import_apertures_5 = ImportApertures(lay=cluster_25.layer_name_2)
import_apertures_6 = ImportApertures(lay=cluster_26.layer_name_2)
glassmod = HBGlassModifier(name=cluster_21.rad_name_2, trans=cluster_21.result)  # -> modifier; plug-in component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
glassmod_2 = HBGlassModifier(name=cluster_22.rad_name_2, trans=cluster_22.result)  # -> modifier; plug-in component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
glassmod_3 = HBGlassModifier(name=cluster_23.rad_name_2, trans=cluster_23.result)  # -> modifier; plug-in component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
glassmod_4 = HBGlassModifier(name=cluster_24.rad_name_2, trans=cluster_24.result)  # -> modifier; plug-in component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
glassmod_5 = HBGlassModifier(name=cluster_25.rad_name_2, trans=cluster_25.result)  # -> modifier; plug-in component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
glassmod_6 = HBGlassModifier(name=cluster_26.rad_name_2, trans=cluster_26.result)  # -> modifier; plug-in component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
aperture = HBAperture(geo=import_apertures_3, name=cluster_23.rad_name_2, rad_mod=glassmod_3)  # -> out, apertures; plug-in component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
aperture_2 = HBAperture(geo=import_apertures_4, name=cluster_24.rad_name_2, rad_mod=glassmod_4)  # -> out, apertures; plug-in component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
aperture_3 = HBAperture(geo=import_apertures_6, name=cluster_26.rad_name_2, rad_mod=glassmod_6)  # -> out, apertures; plug-in component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
aperture_4 = HBAperture(geo=import_apertures_2, name=cluster_22.rad_name_2, rad_mod=glassmod_2)  # -> out, apertures; plug-in component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
aperture_5 = HBAperture(geo=import_apertures_5, name=cluster_25.rad_name_2, rad_mod=glassmod_5)  # -> out, apertures; plug-in component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
aperture_6 = HBAperture(geo=import_apertures, name=cluster_21.rad_name_2, rad_mod=glassmod)  # -> out, apertures; plug-in component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
colour_swatch_7 = ColourSwatch(SwatchColor=RGB(0, 128, 0))
vizall_11 = HBVisualizeAll(hb_objs=flatten(aperture.apertures))  # -> geo; plug-in component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
vizall_12 = HBVisualizeAll(hb_objs=flatten(aperture_2.apertures))  # -> geo; plug-in component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
vizall_13 = HBVisualizeAll(hb_objs=flatten(aperture_3.apertures))  # -> geo; plug-in component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
vizall_14 = HBVisualizeAll(hb_objs=flatten(aperture_4.apertures))  # -> geo; plug-in component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
vizall_15 = HBVisualizeAll(hb_objs=flatten(aperture_5.apertures))  # -> geo; plug-in component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
colour_swatch_8 = ColourSwatch(SwatchColor=RGB(0, 238, 255))
vizall_16 = HBVisualizeAll(hb_objs=flatten(aperture_6.apertures))  # -> geo; plug-in component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
custom_preview_11 = CustomPreview(Geometry=vizall_11, Material=colour_swatch_3)
custom_preview_12 = CustomPreview(Geometry=vizall_12, Material=colour_swatch_4)
custom_preview_13 = CustomPreview(Geometry=vizall_13, Material=ColourSwatch(SwatchColor=RGB(0, 115, 255)))
custom_preview_14 = CustomPreview(Geometry=vizall_14, Material=ColourSwatch(SwatchColor=RGB(0, 115, 255)))
custom_preview_15 = CustomPreview(Geometry=vizall_15, Material=colour_swatch_5)
custom_preview_16 = CustomPreview(Geometry=vizall_16, Material=colour_swatch_6)
layer_names_2 = Merge(
    Data1=cluster_23.layer_name_2,
    Data2=cluster_24.layer_name_2,
    Data3=cluster_25.layer_name_2,
    Data4=cluster_21.layer_name_2,
    Data5=cluster_26.layer_name_2,
    Data6=cluster_22.layer_name_2)
layer_colours_2 = Merge(
    Data1=cluster_23.colour_of_layer_in_rhino_3,
    Data2=cluster_24.colour_of_layer_in_rhino_3,
    Data3=cluster_25.colour_of_layer_in_rhino_3,
    Data4=cluster_21.colour_of_layer_in_rhino_3,
    Data5=cluster_26.colour_of_layer_in_rhino_3,
    Data6=cluster_22.colour_of_layer_in_rhino_3)
apertures = Merge(
    Data1=aperture_3.apertures,
    Data2=aperture.apertures,
    Data3=aperture_2.apertures,
    Data4=aperture_5.apertures,
    Data5=aperture_6.apertures,
    Data6=aperture_4.apertures)
data_2 = Data(apertures)
clean_2 = CleanTree(RemoveNulls=True, RemoveInvalid=True, RemoveEmpty=True, Tree=data_2)

reflectance_11 = ValueList({"0.01", "0.02", "0.03", "0.04", "0.05", "0.06", "0.07", "0.08", "0.09", "0.10"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}, selected="0.20")

reflectance_12 = ValueList({"0.01", "0.02", "0.03", "0.04", "0.05", "0.06", "0.07", "0.08", "0.09", "0.10"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}, selected="0.10")

reflectance_13 = ValueList({"0.01", "0.02", "0.03", "0.04", "0.05", "0.06", "0.07", "0.08", "0.09", "0.10"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}, selected="0.20")
colour_swatch_9 = ColourSwatch(SwatchColor=RGB(0, 0, 0))

reflectance_14 = ValueList({"0.01", "0.02", "0.03", "0.04", "0.05", "0.06", "0.07", "0.08", "0.09", "0.10"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}, selected="0.01")
colour_swatch_10 = ColourSwatch(SwatchColor=RGB(239, 120, 250))

point = Point()  # disabled
point_2 = Point()  # disabled

# ----
# Occupancy schedule according to EN17037 E.3.1
gene_pool = GenePool(
    Decimals=0,
    Maximum=1,
    Minimum=0,
    Value=[0.5, 0.5, 0.5, 0.5, 0.5, 0.5, 0.5, 0, 0, 0, 0, 0, 0, 0, 0, 0, 0, 0, 0, 0.5, 0.5, 0.5, 0.5, 0.5])
gene_pool_2 = GenePool(
    Decimals=0,
    Maximum=1,
    Minimum=0,
    Value=[0.5, 0.5, 0.5, 0.5, 0.5, 0.5, 0.5, 0, 1, 1, 1, 1, 1, 1, 1, 1, 1, 1, 1, 0.5, 0.5, 0.5, 0.5, 0.5])
weeklyschedule = HBWeeklySchedule(
    sun=gene_pool,
    mon=gene_pool_2,
    tue=gene_pool_2,
    wed=gene_pool_2,
    thu=gene_pool_2,
    fri=gene_pool_2,
    sat=gene_pool,
    name="GlareSchedule_EN17037")  # -> out, schedule, idf_year, idf_week, idf_days; plug-in component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
schtodata = HBScheduleToData(schedule=weeklyschedule.schedule, week_start_day="MONDAY")  # -> data; plug-in component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

# ----
# HONEYBEE MODEL
# Choose weatherfile
concatenate_2 = Concatenate(FragmentA=file_path, FragmentA_2="\", WeatherFile=weather_file)
file_path_2 = FilePath(concatenate_2)
wea = HBWeaFromEPW(epw_file=file_path_2)  # -> wea; plug-in component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

point_3 = Point()  # disabled
point_4 = Point()  # disabled

panel_3 = Panel("""DGP_e<5% >= 0,45
0,40 < DGP_e<5% <= 0,45
0,35 < DGP_e<5% <= 0,40
DGP_e<5% <= 0,35""")
panel_4 = Panel("""0,45
0,40
0,35""")
colrange = LBColorRange()  # -> reverse(colors); plug-in component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
merge = Merge(
    Data1=ColourSwatch(SwatchColor=RGB(235, 39, 0)),
    Data2=ColourSwatch(SwatchColor=RGB(235, 70, 0)),
    Data3=ColourSwatch(SwatchColor=RGB(235, 113, 0)),
    Data4=ColourSwatch(SwatchColor=RGB(237, 144, 14)),
    Data5=ColourSwatch(SwatchColor=RGB(247, 198, 52)),
    Data6=ColourSwatch(SwatchColor=RGB(250, 237, 90)),
    Data7=ColourSwatch(SwatchColor=RGB(224, 230, 145)),
    Data8=ColourSwatch(SwatchColor=RGB(186, 209, 219)),
    Data9=ColourSwatch(SwatchColor=RGB(159, 189, 237)),
    Data10=ColourSwatch(SwatchColor=RGB(111, 143, 199)),
    Data11=ColourSwatch(SwatchColor=RGB(74, 105, 168)))
merge_2 = Merge(
    Data1=ColourSwatch(SwatchColor=RGB(235, 39, 0)),
    Data2=ColourSwatch(SwatchColor=RGB(237, 181, 14)),
    Data3=ColourSwatch(SwatchColor=RGB(82, 204, 204)),
    Data4=ColourSwatch(SwatchColor=RGB(118, 176, 93)))  # -> reverse(Result)
merge_3 = Merge(
    Data1=ColourSwatch(SwatchColor=RGB(235, 39, 0)),
    Data2=ColourSwatch(SwatchColor=RGB(235, 70, 0)),
    Data3=ColourSwatch(SwatchColor=RGB(235, 113, 0)),
    Data4=ColourSwatch(SwatchColor=RGB(237, 144, 14)),
    Data5=ColourSwatch(SwatchColor=RGB(247, 198, 52)),
    Data6=ColourSwatch(SwatchColor=RGB(250, 237, 90)),
    Data7=ColourSwatch(SwatchColor=RGB(224, 230, 145)),
    Data8=ColourSwatch(SwatchColor=RGB(186, 209, 219)),
    Data9=ColourSwatch(SwatchColor=RGB(159, 189, 237)),
    Data10=ColourSwatch(SwatchColor=RGB(111, 143, 199)),
    Data11=ColourSwatch(SwatchColor=RGB(74, 105, 168)))
merge_4 = Merge(
    Data1=ColourSwatch(SwatchColor=RGB(235, 39, 0)),
    Data2=ColourSwatch(SwatchColor=RGB(235, 113, 0)),
    Data3=ColourSwatch(SwatchColor=RGB(247, 198, 52)),
    Data4=ColourSwatch(SwatchColor=RGB(224, 230, 145)),
    Data5=ColourSwatch(SwatchColor=RGB(159, 189, 237)),
    Data6=ColourSwatch(SwatchColor=RGB(74, 105, 168)))
merge_5 = Merge(
    Data1=ColourSwatch(SwatchColor=RGB(235, 39, 0)),
    Data2=ColourSwatch(SwatchColor=RGB(237, 181, 14)),
    Data3=ColourSwatch(SwatchColor=RGB(171, 171, 171)))  # -> reverse(Result)
colour = Colour(merge)
colour_2 = Colour(merge_3)
colour_3 = Colour(merge_4)
legendparcategorized = LBLegendParametersCategorized(domain=panel_4, colors=merge_2, categories=panel_3)  # -> leg_par; plug-in component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
legendpar = LBLegendParameters(min="95", max="100", seg_count="6", colors=colour, num_decimals="0")  # -> leg_par; plug-in component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

# ----
# 2a)
# Create layers in Rhino
_0_solids = Panel(layer_names)
lb_falsestarttoggle_7 = LBFalseStartToggle(False)
bake_modify_layer = BakeModifyLayer(Bake=lb_falsestarttoggle_7)
_1_glazings = Panel(layer_names_2)
_3_analysis = Panel("""Sensor
Sensor_IkkeAnvendt
Elevation
Section_Horisontal
Section_Vertical""")

# ----
# Run Recipe
button = Button()

# ----
# Shadings
panel_5 = Panel("2_Shadings::")
layer_colours_3 = Merge(
    Data1=ColourSwatch(SwatchColor=RGB(88, 159, 214)),
    Data2=ColourSwatch(SwatchColor=RGB(191, 237, 185)),
    Data3=colour_swatch_9,
    Data4=colour_swatch_10)

cluster_27 = Cluster_2(A=panel_5, layer="Terrain", reflectance=reflectance_12)  # -> rad_name_2, rhino_layer_name_2
cluster_28 = Cluster_2(A=panel_5, layer="Overhang", reflectance=reflectance_13)  # -> rad_name_2, rhino_layer_name_2
cluster_29 = Cluster_2(A=panel_5, layer="Fins", reflectance=reflectance_14)  # -> rad_name_2, rhino_layer_name_2
cluster_30 = Cluster_2(A=panel_5, layer="Context", reflectance=reflectance_11)  # -> rad_name_2, rhino_layer_name_2
cluster_31 = Cluster_3(lay=cluster_27.rhino_layer_name_2)
cluster_32 = Cluster_3(lay=cluster_28.rhino_layer_name_2)
cluster_33 = Cluster_3(lay=cluster_29.rhino_layer_name_2)
cluster_34 = Cluster_3(lay=cluster_30.rhino_layer_name_2)
opaquemod_11 = HBOpaqueModifier(name=cluster_27.rad_name_2, reflect=reflectance_12)  # -> modifier; plug-in component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
opaquemod_12 = HBOpaqueModifier(name=cluster_28.rad_name_2, reflect=reflectance_13)  # -> modifier; plug-in component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
opaquemod_13 = HBOpaqueModifier(name=cluster_29.rad_name_2, reflect=reflectance_14)  # -> modifier; plug-in component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
opaquemod_14 = HBOpaqueModifier(name=cluster_30.rad_name_2, reflect=reflectance_11)  # -> modifier; plug-in component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
face_11 = HBFace(geo=cluster_31, name=cluster_27.rad_name_2, rad_mod=opaquemod_11)  # -> out, faces; plug-in component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
face_12 = HBFace(geo=cluster_32, name=cluster_28.rad_name_2, rad_mod=opaquemod_12)  # -> out, faces; plug-in component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
face_13 = HBFace(geo=cluster_33, name=cluster_29.rad_name_2, rad_mod=opaquemod_13)  # -> out, faces; plug-in component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
face_14 = HBFace(geo=cluster_34, name=cluster_30.rad_name_2, rad_mod=opaquemod_14)  # -> out, faces; plug-in component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

vizall_17 = HBVisualizeAll(hb_objs=flatten(face_14.faces))  # -> geo; plug-in component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
vizall_18 = HBVisualizeAll(hb_objs=flatten(face_11.faces))  # -> geo; plug-in component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
vizall_19 = HBVisualizeAll(hb_objs=flatten(face_12.faces))  # -> geo; plug-in component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
vizall_20 = HBVisualizeAll(hb_objs=flatten(face_13.faces))  # -> geo; plug-in component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
custom_preview_17 = CustomPreview(Geometry=vizall_17, Material=ColourSwatch(SwatchColor=RGB(61, 61, 61)))
custom_preview_18 = CustomPreview(Geometry=vizall_18, Material=ColourSwatch(SwatchColor=RGB(252, 252, 252)))
custom_preview_19 = CustomPreview(Geometry=vizall_19, Material=colour_swatch_9)
custom_preview_20 = CustomPreview(Geometry=vizall_20, Material=colour_swatch_10)
layer_names_3 = Merge(
    Data1=cluster_30.rhino_layer_name_2,
    Data2=cluster_27.rhino_layer_name_2,
    Data3=cluster_28.rhino_layer_name_2,
    Data4=cluster_29.rhino_layer_name_2)
shading = Merge(Data1=face_14.faces, Data2=face_11.faces, Data3=face_12.faces, Data4=face_13.faces)
data_3 = Data(shading)
clean_3 = CleanTree(RemoveNulls=True, RemoveInvalid=True, RemoveEmpty=True, Tree=data_3)

_2_shading = Panel(layer_names_3)

# ----
# Model + Grids
height_of_sensor_plane = ValueList({"50 mm": "50", "100 mm": "100", "150 mm": "150", "200 mm": "200", "250 mm": "250", "300 mm": "300", "350 mm": "350", "400 mm": "400", "450 mm": "450", "500 mm": "500", "550 mm": "550", "600 mm": "600", "650 mm": "650", "700 mm": "700", "750 mm": "750", "800 mm": "800", "850 mm": "850", "900 mm": "900", "950 mm": "950", "1000 mm": "1000", "1100 mm": "1100", "1200 mm": "1200", "1300 mm": "1300", "1400 mm": "1400", "1500 mm": "1500"}, selected="1200 mm")
geometry_pipeline = GeometryPipeline(
    GroupByLayer=False,
    GroupByType=False,
    IncludeHidden=True,
    IncludeLocked=True,
    LayerFilter="3_Analysis::Sensor",
    NameFilter="*",
    SublayerFiltering=True,
    TypeFilter=1073741880)
grid_density = ValueList({"50 mm": "50mm", "100 mm": "100mm", "150 mm": "150mm", "200 mm": "200mm", "250 mm": "250mm", "300 mm": "300mm", "350 mm": "350mm", "400 mm": "400mm", "450 mm": "450mm", "500 mm": "500mm", "550 mm": "550mm", "600 mm": "600mm", "650 mm": "650mm", "700 mm": "700mm", "750 mm": "750mm", "800 mm": "800mm", "850 mm": "850mm", "900 mm": "900mm", "950 mm": "950mm", "1000 mm": "1000mm"}, selected="500 mm")
unit_z = UnitZ(Factor=height_of_sensor_plane)
convert_to_document_units = ConvertToDocumentUnits(ValueString=grid_density)
move = Move(Geometry=geometry_pipeline, Motion=unit_z)  # -> Geometry, Transform
convert_to_document_units_2 = ConvertToDocumentUnits(ValueString="0.2m")
genpts = LBGeneratePointGrid(geometry=move.Geometry, grid_size=convert_to_document_units, quad_only=Toggle(True))  # -> points, vectors, face_areas, graft(mesh); plug-in component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
sensorgrid = HBRadialSensorGrid(positions=genpts.points, mesh_radius=convert_to_document_units_2)  # -> grid, points, vecs, mesh; plug-in component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
model = HBModel(faces=flatten([clean, clean_3]), apertures=flatten(clean_2), name="sample_model_grid")  # -> report, model; plug-in component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
assigngridsviews = HBAssignGridsAndViews(model=model.model, grids=flatten(sensorgrid.grid))  # -> model; plug-in component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

annualglare = HBImagelessAnnualGlare(model=assigngridsviews, wea=wea, north=north_rotation_counter_clockwise, schedule=schtodata, run=button)  # -> report, results, GA; plug-in component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

data_recorder = DataRecorder(annualglare.results, DataLimit=3, RecordData=True)
panel_6 = Panel(data_recorder)

target_time = Panel("5")
expression = Expression(x=target_time, Expression="100-x")
list_item = ListItem(List=data_recorder, Index=0, Wrap=True)  # -> Item, Item1
threshold_en17037 = ValueList({"Minimum, DGP > 0.45": "0.45", "Medium, DGP > 0.40": "0.40", "High, DGP > 0.35": "0.35"}, selected="Minimum, DGP > 0.45")
threshold_en17037_2 = ValueList({"Minimum, DGP > 0.45": "0.45", "Medium, DGP > 0.40": "0.40", "High, DGP > 0.35": "0.35"}, selected="Medium, DGP > 0.40")
threshold_en17037_3 = ValueList({"Minimum, DGP > 0.45": "0.45", "Medium, DGP > 0.40": "0.40", "High, DGP > 0.35": "0.35"}, selected="High, DGP > 0.35")
glaremetrics = HBAnnualGlareMetrics(results=list_item.Item1, occ_sch=schtodata, glare_thresh=threshold_en17037_2, target_time=expression)  # -> out, GA, sGA, pass_fail; plug-in component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
# POST-PROCESSING
glaremetrics_2 = HBAnnualGlareMetrics(results=list_item.Item1, occ_sch=schtodata, glare_thresh=threshold_en17037, target_time=expression)  # -> out, GA, sGA, pass_fail; plug-in component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
glaremetrics_3 = HBAnnualGlareMetrics(results=list_item.Item1, occ_sch=schtodata, glare_thresh=threshold_en17037_3, target_time=expression)  # -> out, GA, sGA, pass_fail; plug-in component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
expression_2 = Expression(sGA=glaremetrics.sGA, Expression="Format(\"sGA_DGP>0.40 = {0:0.0} %\", sGA*100)")
expression_3 = Expression(sGA=glaremetrics_3.sGA, Expression="Format(\"sGA_DGP>0.35 = {0:0.0} %\", sGA*100)")
expression_4 = Expression(sGA=glaremetrics_2.sGA, Expression="Format(\"sGA_DGP>0.45 = {0:0.0} %\", sGA*100)")
panel_7 = Panel([expression_4, expression_2, expression_3])

larger = LargerThan(FirstNumber=glaremetrics_2.GA, SecondNumber="95")  # -> LargerThan, OrEqualTo
larger_2 = LargerThan(FirstNumber=glaremetrics.GA, SecondNumber="95")  # -> LargerThan, OrEqualTo
larger_3 = LargerThan(FirstNumber=glaremetrics_3.GA, SecondNumber="95")  # -> LargerThan, OrEqualTo
ghpython_script = GhPythonScript(minimum=larger.OrEqualTo, medium=larger_2.OrEqualTo, maximum=larger_3.OrEqualTo)  # -> out, output_list; inputs minimum: list, medium: list, maximum: list
# ---------- ghpython_script: Python ----------
def merge_lists(maximum, medium, minimum):
    def rule(value):
        if value:
            return "3"
        else:
            return "2" if medium[i] else "1" if minimum[i] else 0

    output_list = [rule(value) for i, value in enumerate(maximum)]
    return output_list

# Inputs: 'maximum', 'medium', and 'minimum' (lists of True/False values)
output_list = merge_lists(maximum, medium, minimum)
# ---------- end ghpython_script ----------
panel_8 = Panel(ghpython_script.output_list)

# ----
# Visualize Hourly Illuminance for a Sensor
swatch = ColourSwatch(SwatchColor=RGB(219, 215, 215))
face_normals = FaceNormals(Mesh=sensorgrid.mesh)  # -> Centers, Normals
pt = Point(sensorgrid.points)
panel_9 = Panel("""Night
Imperceptable Glare
Perceptable Glare
Disturbing Glare
Intolerable Glare""")
panel_10 = Panel("""0.01
0.35
0.4
0.45""")
bang = ExplodeTree(Data=pt)  # -> Branch0, Branch1
col = Colour([swatch, ColourSwatch(SwatchColor=RGB(69, 173, 101)), ColourSwatch(SwatchColor=RGB(255, 255, 0)), ColourSwatch(SwatchColor=RGB(255, 162, 0)), ColourSwatch(SwatchColor=RGB(255, 0, 0))])
list_length = ListLength(List=face_normals.Centers)
point_list = PointList(Points=face_normals.Centers)
item = ListItem(List=bang.Branch0, Index=Slider(954, range=0..2000), Wrap=True)
legendparcategorized_2 = LBLegendParametersCategorized(domain=panel_10, colors=col, categories=panel_9)  # -> leg_par; plug-in component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
total_amount_of_points = Panel(list_length)
data_4 = Data(glaremetrics_2.GA)
sph = Sphere(Base=item, Radius="0.2")
annualtodata = HBAnnualResultsToData(results=data_4, sel_pts=item, all_pts=pt)  # -> report, data; plug-in component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
hourlyplot = LBHourlyPlot(data=annualtodata.data, base_pt="50,0,0", legend_par=legendparcategorized_2)  # -> report, mesh, legend, borders, labels, title; plug-in component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

# ----
# Visualize Glare Autonomy
colour_swatch_11 = ColourSwatch(SwatchColor=RGB(118, 176, 93))
panel_11 = Panel("""DGP_e<5% ≥ 0,45
0,40 < DGP_e<5% ≤ 0,45
0,35 < DGP_e<5% ≤ 0,40
DGP_e<5% ≤ 0,35""")
panel_12 = Panel("""0.99
1.99
2.99""")
merge_6 = Merge(
    Data1=colour_swatch_11,
    Data2=ColourSwatch(SwatchColor=RGB(82, 153, 204)),
    Data3=ColourSwatch(SwatchColor=RGB(237, 181, 14)),
    Data4=ColourSwatch(SwatchColor=RGB(235, 39, 0)))  # -> reverse(Result)
legendparcategorized_3 = LBLegendParametersCategorized(domain=panel_12, colors=merge_6, categories=panel_11)  # -> leg_par; plug-in component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
mjoin = MeshJoin(Meshes=flatten(sensorgrid.mesh))
data_5 = Data(glaremetrics_2.GA)
panel_13 = Panel("""Daylight Glare Probability (DGP)
according to EN17037""")
concat = Concatenate(FragmentA=panel_13, FragmentB=flatten(expression_4), FragmentD=expression_2, FragmentF=expression_3)
panel_14 = Panel(concat)
heatmap = LBSpatialHeatmap(values=ghpython_script.output_list, mesh=mjoin, legend_par=legendparcategorized_3, legend_title="%", global_title=concat)  # -> mesh, legend, title, colors, legend_par; plug-in component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

# ----
# Visualize Glare Autonomy
panel_15 = Panel("0")
legendpar_2 = LBLegendParameters(min=panel_15, max="100", seg_count="12", colors=colour_2, num_decimals="0")  # -> leg_par; plug-in component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
mjoin_2 = MeshJoin(Meshes=flatten(sensorgrid.mesh))
data_6 = Data(glaremetrics_2.GA)
panel_16 = Panel("""Glare Autonomy
(The fraction of occupied hours in which the view is free of glare)""")
heatmap_2 = LBSpatialHeatmap(values=data_6, mesh=mjoin_2, legend_par=legendpar_2, legend_title="%", global_title=panel_16)  # -> mesh, legend, title, colors, legend_par; plug-in component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

# ----
# Visualize Glare Autonomy
panel_17 = Panel("95")
legendpar_3 = LBLegendParameters(min=panel_17, max="100", seg_count="6", colors=colrange, num_decimals="0")  # -> leg_par; plug-in component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
mjoin_3 = MeshJoin(Meshes=flatten(sensorgrid.mesh))
data_7 = Data(glaremetrics_2.GA)
panel_18 = Panel("""Glare Autonomy (GA)
DGP threshold: 45%
Target GA fraction: 95%

GA = The fraction of occupied hours in which the DGP is lower than the threshold""")
heatmap_3 = LBSpatialHeatmap(values=data_7, mesh=mjoin_3, legend_par=legendparcategorized, legend_title="%", global_title=panel_18)  # -> mesh, legend, title, colors, legend_par; plug-in component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

expression_5 = Expression(sGA=glaremetrics_2.sGA, Expression="Format(\"sGA = {0:0.0} %\", sGA*100)")
panel_19 = Panel(data_6)
panel_20 = Panel(expression_5)
concatenate_3 = Concatenate(FragmentA=panel_18, FragmentB=panel_20)
panel_21 = Panel(concatenate_3)

# ----
# Visualize Glare Autonomy
panel_22 = Panel("5")
legendpar_4 = LBLegendParameters(min="0", max="5", seg_count=panel_22, colors=merge_5, num_decimals="0")  # -> leg_par; plug-in component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
mjoin_4 = MeshJoin(Meshes=flatten(sensorgrid.mesh))
data_8 = Data(glaremetrics_2.GA)

subtraction = Subtraction(A="100", B=data_8)

heatmap_4 = LBSpatialHeatmap(values=subtraction, mesh=mjoin_4, legend_par=legendpar_4, legend_title="%", global_title="Disturbing glare frequency")  # -> mesh, legend, title, colors, legend_par; plug-in component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

panel_23 = Panel(data_8)
panel_24 = Panel(subtraction)

# ==== cluster Cluster
layer = ClusterInput()
A = ClusterInput()
transmittance = ClusterInput()
layer_2 = Text(layer)
transmittance_2 = Text(transmittance)

# ----
# Create Rhino layer name
panel = Panel("%")
concatenate = Concatenate(A=A, B=layer_2, C="_", D=transmittance_2, E=panel)
panel_2 = Panel(concatenate)
layer_name = Text(panel_2)

# ----
# Create name for radiance material
concatenate_2 = Concatenate(A=layer_2, B="_", C=transmittance_2, D=panel)
rad_name = Text(concatenate_2)
panel_3 = Panel(concatenate_2)

# ----
# Convert transmittance to decimal number
panel_4 = Panel("100")
division = Division(A=transmittance_2, B=panel_4)

colour_of_layer_in_rhino = ClusterInput()
result = ClusterOutput(division)
colour_of_layer_in_rhino_2 = Colour(colour_of_layer_in_rhino)
rad_name_2 = ClusterOutput(rad_name)
colour_of_layer_in_rhino_3 = ClusterOutput(colour_of_layer_in_rhino_2)
layer_name_2 = ClusterOutput(layer_name)

# ==== cluster ImportApertures
lay = ClusterInput()

# ----
# Import geometry from Rhino and remove extra window panes
panel = Panel("""brep
surface
extrusion
mesh""")
dpipeline = DynamicGeometryPipeline(
    LayerFilter=graft(lay),
    TypeFilter=panel,
    NameFilter="*",
    GroupByLayer=False,
    GroupByType=False,
    IncludeHidden=True,
    IncludeLocked=True,
    enableFullPath=True,
    listenToAttributes=True)
brep = Brep(dpipeline)
deconstruct_brep = DeconstructBrep(Brep=brep)  # -> Faces, Edges, Vertices
area = Area(Geometry=deconstruct_brep.Faces)  # -> Area, Centroid
sort_list = SortList(Keys=area.Area, ValuesValuesA=deconstruct_brep.Faces)  # -> Keys, ValuesValuesA
reverse_list = ReverseList(List=sort_list.ValuesValuesA)
list_item = ListItem(List=reverse_list, Index=0, Wrap=True)
clean = CleanTree(RemoveNulls=True, RemoveInvalid=True, RemoveEmpty=True, Tree=list_item)
geometry = Geometry(clean)

geometry_2 = ClusterOutput(geometry)

# ==== cluster Cluster_2
A = ClusterInput()
layer = ClusterInput()
reflectance = ClusterInput()
layer_2 = Text(layer)
reflectance_2 = Text(reflectance)
concatenate = Concatenate(A=layer_2, B="_", C=reflectance_2)
concatenate_2 = Concatenate(A=A, B=layer_2, C="_", D=reflectance_2)
panel = Panel(concatenate_2)
panel_2 = Panel(concatenate)
rad_name = Text(concatenate)
rhino_layer_name = Text(panel)
rad_name_2 = ClusterOutput(rad_name)
rhino_layer_name_2 = ClusterOutput(rhino_layer_name)

# ==== cluster Cluster_3
panel = Panel("""brep
surface
extrusion
mesh""")
lay = ClusterInput()
dpipeline = DynamicGeometryPipeline(
    LayerFilter=graft(lay),
    TypeFilter=panel,
    NameFilter="*",
    GroupByLayer=False,
    GroupByType=False,
    IncludeHidden=True,
    IncludeLocked=True,
    enableFullPath=True,
    listenToAttributes=True)
clean = CleanTree(RemoveNulls=True, RemoveInvalid=True, RemoveEmpty=True, Tree=dpipeline)
panel_2 = Panel(dpipeline)
geometry = Geometry(clean)
geometry_2 = ClusterOutput(geometry)
